# Grasshopper definition 251102_Cat Scratcher.gh (Grasshopper 1.0.8)

# ---- group: User Input
scratcher_diameter_mm = Slider(100, range=0..100)
scratcher_length_mm = Slider(500, range=0..1000)
rope_width_mm = Slider(10, range=0..100)

# ---- group: Scratching Post
division = Division(A=scratcher_diameter_mm, B=2)
xy = XYPlane(Origin=Point(0, 0, 0))
cyl = Cylinder(Base=xy, Radius=division, Length=scratcher_length_mm)
preview = CustomPreview(Geometry=cyl, Material=ColourSwatch(SwatchColor=RGB(255, 255, 255)))

# ---- group: Add Rope Width to Spiral
division_2 = Division(A=rope_width_mm, B=2)
addition = Addition(A=division, B=division_2)

# ---- group: Make Spiral
xy_2 = XYPlane(Origin=Point(0, 0, 0))
X = UnitX(Factor=1)
move = Move(Geometry=xy_2, Motion=X)  # -> Geometry, Transform
division_3 = Division(A=scratcher_length_mm, B=rope_width_mm)
xy_3 = XYPlane(Origin=Point(0, 0, 0))
Z = UnitZ(Factor=1)
spiral = CSharpScript(B=xy_3, V=Z, Pt=move.Geometry, Pi=rope_width_mm, TC=division_3, R0=addition, R1=addition)  # -> Sp; inputs B: Point3d, V: Vector3d, Pt: Point3d, Pi: Double, TC: Double, R0: Double, R1: Double
# ---------- spiral: C# ----------
// Grasshopper Script Instance
#region Usings
using System;
using System.Linq;
using System.Collections;
using System.Collections.Generic;
using System.Drawing;

using Rhino;
using Rhino.Geometry;

using Grasshopper;
using Grasshopper.Kernel;
using Grasshopper.Kernel.Data;
using Grasshopper.Kernel.Types;
#endregion

public class Script_Instance : GH_ScriptInstance
{
    #region Notes
    /* 
      Members:
        RhinoDoc RhinoDocument
        GH_Document GrasshopperDocument
        IGH_Component Component
        int Iteration

      Methods (Virtual & overridable):
        Print(string text)
        Print(string format, params object[] args)
        Reflect(object obj)
        Reflect(object obj, string method_name)
    */
    #endregion

    private void RunScript(
		Point3d B,
		Vector3d V,
		Point3d Pt,
		double Pi,
		double TC,
		double R0,
		double R1,
		ref object Sp)
    {
        // Write your logic here
        Sp = NurbsCurve.CreateSpiral(B,V,Pt,Pi,TC,R0,R1);
    }
}
# ---------- end spiral ----------

# ---- group: Preview Rope
division_4 = Division(A=rope_width_mm, B=2)
pipe = Pipe(Curve=spiral, Radius=division_4, Caps=2)
preview_2 = CustomPreview(Geometry=pipe, Material=ColourSwatch(SwatchColor=RGBA(144, 71, 145, 107)))

# ---- group: Calc Rope Length
len = Length(Curve=spiral)
round = Round(Number=len)  # -> Nearest, Floor, Ceiling
division_5 = Division(A=round.Ceiling, B=1000)
concat = Concatenate(FragmentA=division_5, FragmentB="m")
concat_2 = Concatenate(FragmentA="Rope Length:  ", FragmentB=concat)

# ---- group: User Input (continued)
# Cat Scratcher Rope Length
panel = Panel(concat_2)
